# Grasshopper definition Extruder.gh (Grasshopper 1.0.7)
# plug-ins: Hops

concatenate = Concatenate(FragmentA="http://127.0.0.1:5000", FragmentB="/createExtruder")
curve = Curve(<curve referenced from the Rhino model>)
hops = Hops(
    _Path=concatenate,
    Curve=curve,
    GeometryHeight=Slider(7.1, range=0..10),
    CacheResultsInMemory=True,
    CacheSolveResults=True,
    RemoteDefinitionLocation="http://127.0.0.1:5000/createExtruder",
    RemoteSolveVersion=(0, 1, 0),
    ShowInput_Enabled=False,
    ShowInput_Path=True,
    SynchronousSolve=True)
