# Grasshopper definition Create Graph.gh (Grasshopper 1.0.7)
# plug-ins: Hops

concatenate = Concatenate(FragmentA="http://127.0.0.1:5000", FragmentB="/createGraphs")
hops = Hops(
    _Path=concatenate,
    CountX=Slider(5, range=0..10),
    CountY=Slider(9, range=0..10),
    Layout=Slider(1, range=0..2),
    CacheResultsInMemory=True,
    CacheSolveResults=True,
    RemoteDefinitionLocation="http://127.0.0.1:5000/createGraphs",
    RemoteSolveVersion=(0, 1, 0),
    ShowInput_Enabled=False,
    ShowInput_Path=True,
    SynchronousSolve=True)  # -> Nodes, Edges
